# Grasshopper definition EqualCubeLandscape.gh (Grasshopper 0.9.76)
# plug-ins: Python Interpreter

rec = Rectangle({Plane=PlaneXY(-11.5, -8.5, 0), Size=Domain2(u=0..23, v=0..17)})

multiplication = Multiplication(A=Slider(1, range=0..10), B=-1)
offset = Offset(Curve=rec, Distance=Slider(1, range=0..10), Plane=PlaneXY(0, 0, 0), Corners=1)
offset_2 = Offset(Curve=rec, Distance=multiplication, Plane=PlaneXY(0, 0, 0), Corners=1)
cp = ControlPoints(Curve=offset)  # -> Points, Weights, Knots
bnd = Bounds2D(Coordinates=cp.Points)
rec_2 = Rectangle(offset_2)
dedom2 = DeconstructDomain²(Domain=bnd)  # -> UComponent, VComponent
rectangle = Rectangle(Plane=PlaneXY(0, 0, 0), XSize=dedom2.UComponent, YSize=dedom2.VComponent, Radius=0)  # -> Rectangle, Length
rec_3 = Rectangle(rectangle.Rectangle)

box = CenterBox(Base=PlaneXY(0, 0, 0), X=1, Y=1, Z=1)
number_slider = Slider(3, range=0..10)

rec_4 = Rectangle(rec_3)
number_slider_2 = Slider(200, range=0..1000)
number_slider_3 = Slider(213, range=0..1000)
boxrec = BoxRectangle(Rectangle=rec_4, Height=Slider(5.233, range=0..10))
multiplication_2 = Multiplication(A=number_slider_3, B=Slider(765, range=0..1000))
pop3d = Populate3D(Region=boxrec, Count=number_slider_2, Seed=number_slider_3)
multiplication_3 = Multiplication(A=multiplication_2, B=Slider(183, range=0..1000))
pop3d_2 = Populate3D(Region=box, Count=number_slider_2, Seed=multiplication_2)
random = Random(Range=Domain(0, 1), Number=1, Seed=multiplication_3)
pi = Pi(Factor=2)
multiplication_4 = Multiplication(A=random, B=pi)
box_2 = CenterBox(Base=pop3d, X=number_slider, Y=number_slider, Z=number_slider)
rot3d = Rotate3D(Geometry=box_2, Angle=multiplication_4, Center=pop3d, Axis=pop3d_2)  # -> Geometry, Transform
jumbled_cubes = Brep(rot3d.Geometry)

jumbled_cubes_2 = Brep(jumbled_cubes)
sunion = SolidUnion(Breps=jumbled_cubes_2)
brep = Brep(sunion)

brep_2 = Brep(brep)
volume = Volume(Geometry=brep_2)  # -> Volume, Centroid
larger = LargerThan(FirstNumber=volume.Volume, SecondNumber=0)  # -> LargerThan, OrEqualTo
dispatch = Dispatch(List=brep_2, DispatchPattern=larger.LargerThan)  # -> ListA, ListB
debrep = DeconstructBrep(Brep=dispatch.ListB)  # -> Faces, Edges, Vertices
flip = Flip(Surface=debrep.Faces)  # -> Surface, Result
join = BrepJoin(Breps=flip.Surface)  # -> flatten(Breps), Closed
weave = Weave(Pattern=larger.LargerThan, Stream0=dispatch.ListA, Stream1=join.Breps, NullGaps=False)
brep_3 = Brep(weave)

xy = XYPlane(Origin=Point(0, 0, 0))
rec_5 = Rectangle(rec_2)
chunkytoweringreliefcubes = Curve([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, null, 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, null, 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, null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])
path = FilePath("\\psf\Home\Documents\drawings\penplotter\Base.3dm")
save = Button()

brep_4 = Brep(brep_3)
number_slider_4 = Slider(17.25, range=0..100)
neg = Negative(Value=number_slider_4)
neg_2 = Negative(Value=Slider(10, range=0..10))
dom = ConstructDomain(DomainStart=neg, DomainEnd=number_slider_4)
xy_2 = XYPlane(Origin=Point(0, 0, 0))

dom_2 = ConstructDomain(DomainStart=neg_2, DomainEnd=Slider(2.46, range=0..10))

box_3 = DomainBox(Base=xy_2, X=dom, Y=dom, Z=dom_2)
sdiff = SolidDifference(BrepsA=brep_4, BrepsB=box_3)
brep_5 = Brep(sdiff)

brep_6 = Brep(brep_5)
debrep_2 = DeconstructBrep(Brep=brep_6)  # -> Faces, Edges, Vertices
pt = Point(Point(0.5, 0.5, 0))
evalsrf = EvaluateSurface(Surface=reparameterize(debrep_2.Faces), Point=pt)  # -> Point, Normal, Frame
unit = UnitVector(Vector=evalsrf.Normal)
pdecon = Deconstruct(Point=unit)  # -> XComponent, YComponent, ZComponent
neg_3 = Negative(Value=1)
equals = Equality(FirstNumber=pdecon.ZComponent, SecondNumber=neg_3)  # -> Equality, Inequality
dispatch_2 = Dispatch(List=debrep_2.Faces, DispatchPattern=equals.Equality)  # -> ListA, ListB
srf = Surface(dispatch_2.ListB)
srf_2 = Surface(dispatch_2.ListA)
join_2 = BrepJoin(Breps=srf)  # -> Breps, Closed
brep_7 = Brep(flatten(join_2.Breps))

brep_8 = Brep(flatten(brep_7))
md_slider = MDSlider(
    slider_value=Point(0.4597555021, 0.2711888755, 0.5),
    SliderMode=0,
    x_domain=Domain(0, 1),
    y_domain=Domain(0, 1),
    z_domain=Domain(0, 1))
sph = Sphere(Base=PlaneXY(0, 0, 0), Radius=1)
evalsrf_2 = EvaluateSurface(Surface=reparameterize(sph), Point=md_slider)  # -> Point, Normal, Frame
pln = Plane(evalsrf_2.Frame)
bbox = BoundingBox(Content=brep_8, Plane=pln, UnionBox=True)  # -> Box, Box_2
debox = DeconstructBox(Box=bbox.Box_2)  # -> Plane, X, Y, Z
range = Range(Domain=debox.Z, Steps=Slider(500, range=0..1000))
contour = ContourEx(Shape=brep_8, Plane=pln, Offsets=range)
crv = Curve(flatten(contour))

project = Project(Geometry=crv, Plane=xy)  # -> Geometry, Transform
trim = TrimWithRegion(Curve=project.Geometry, Region=rec_5)  # -> flatten(Inside), Outside
crvs = Curve(trim.Inside)
preview = CustomPreview(Geometry=crvs, Shader=ColourSwatch(SwatchColor=RGB(0, 0, 0)))
python = PythonScript(folder=path, filename="ChunkyToweringReliefCubes", geometry_tree=crvs, write_files=save)  # -> out, output_file_names; inputs geometry_tree: tree of Polyline, write_files: Boolean
# ---------- python: Python ----------
# Inputs
#   folder, a filepath string. Possibly includes a filename that would need to be removed
#   filename, a string that would serve as the basename for the output files.
#   geometry_tree, a data tree of geometry. Each branch should become a separate plot
#   write_files, a boolean trigger that causes all the files to be written

# Outputs
#   output_file_names

import cPickle as pickle
import os
import shutil


def rhino_to_plottable(rhino_geom):
    """Takes rhino polylines or point arrays
    and outputs plottable geometries resempling linestrings
    """
    return [
        (rhino_geom.Item[i].X, rhino_geom.Item[i].Y)
        for i in range(rhino_geom.Count) 
    ]


def clean_folder_path(raw_folder_path):
    return os.path.dirname(raw_folder_path)


def overwrite_directory(path):
    if os.path.exists(path):
        shutil.rmtree(path)
    os.makedirs(path)


def export(tree, folder_path, filename):
    """
    Make a folder based on filename
    For branch in tree:
        make filename for individual plot run
        convert items to plottable geometries
        pickle plottable geometries to filename with filename in folder
    """
    new_folder_path = os.path.join(
        clean_folder_path(folder_path), filename)
    overwrite_directory(new_folder_path)
    output_files = []
    for i in range(tree.BranchCount):
        basename = filename + '-plot-' + str(i) + '.pkl'
        output_path = os.path.join(new_folder_path, basename)
        polylines = tree.Branch(i)
        geoms = [rhino_to_plottable(line) for line in polylines]
        output_files.append(output_path)
        with open(output_path, 'wb') as output_file:
            pickle.dump(geoms, output_file)
    return output_files


if write_files:
    output_file_names = export(geometry_tree, folder, filename)
# ---------- end python ----------
panel = Panel(python.output_file_names)
panel_2 = Panel(python.out)
