# Grasshopper definition PerturbationCurves.gh (Grasshopper 0.9.76)

construct_point = ConstructPoint(XCoordinate=0, YCoordinate=0, ZCoordinate=0)
construct_point_2 = ConstructPoint(XCoordinate=Slider(10, range=0..10), YCoordinate=0, ZCoordinate=0)
number_of_staffs = Slider(5, range=0..10)
lines_per_staff = Slider(5, range=0..10)
line = Line(StartPoint=construct_point, EndPoint=construct_point_2)

distance_between_bars = Slider(0.765, range=0..1)
number_slider = Slider(40, range=0..1000)
seed = Slider(40, range=0..1000)
curve = Curve(line)
divide_curve = DivideCurve(Curve=curve, Count=number_slider, Kinks=False)  # -> Points, Tangents, Parameters
horizontal_frame = HorizontalFrame(Curve=reparameterize(curve), Parameter="0.5")
panel = Panel("""0.25
-0.25""")
number = Number(distance_between_bars)
deconstruct_plane = DeconstructPlane(Plane=horizontal_frame)  # -> Origin, XAxis, YAxis, ZAxis
multiplication = Multiplication(A=number, B=panel)
dispatch = Dispatch(List=multiplication, DispatchPattern=[True, False])  # -> ListA, ListB
random = Random(Range=Domain(0, 1), Number=number_slider, Seed=seed)
construct_domain = ConstructDomain(DomainStart=dispatch.ListA, DomainEnd=dispatch.ListB)
remap_numbers = RemapNumbers(Value=random, Source=Domain(0, 1), Target=construct_domain)  # -> Mapped, Clipped
amplitude = Amplitude(Vector=deconstruct_plane.YAxis, Amplitude=remap_numbers.Mapped)
point = Point(divide_curve.Points)
move = Move(Geometry=point, Motion=amplitude)  # -> Geometry, Transform
point_2 = Point(move.Geometry)

point_3 = Point(point_2)
nurbs_curve = NurbsCurve(Vertices=point_3, Degree=Slider(3, range=0..10), Periodic=False)  # -> Curve, Length, Domain
curve_2 = Curve(nurbs_curve.Curve)

curvature_factor = Slider(0.027, range=0..0.05)
number_slider_2 = Slider(1023, range=0..10000)
curve_3 = Curve(curve_2)
divide_curve_2 = DivideCurve(Curve=curve_3, Count=number_slider_2, Kinks=False)  # -> Points, Tangents, Parameters
curvature = Curvature(Curve=curve_3, Parameter=divide_curve_2.Parameters)  # -> Point, Curvature, Curvature_2
range = Range(Domain=Domain(0, 1), Steps=number_slider_2)
vector_length = VectorLength(Vector=curvature.Curvature)
circle = Circle(curvature.Curvature_2)
mass_addition = MassAddition(Input=vector_length)  # -> Result, PartialResults
multiplication_2 = Multiplication(A=mass_addition.PartialResults, B=curvature_factor)
construct_point_3 = ConstructPoint(XCoordinate=range, YCoordinate=multiplication_2, ZCoordinate=0)
point_4 = Point(construct_point_3)
nurbs_curve_2 = NurbsCurve(Vertices=point_4, Degree=3, Periodic=False)  # -> Curve, Length, Domain
divide_curve_3 = DivideCurve(Curve=nurbs_curve_2.Curve, Count=number_slider_2, Kinks=False)  # -> Points, Tangents, Parameters
deconstruct = Deconstruct(Point=divide_curve_3.Points)  # -> XComponent, YComponent, ZComponent
evaluate_length = EvaluateLength(Curve=curve_3, Length=deconstruct.XComponent, Normalized=True)  # -> Point, Tangent, Parameter
point_5 = Point(evaluate_length.Point)

number_slider_3 = Slider(91.5432, range=0..100)

point_6 = Point(point_5)
polyline = PolyLine(Vertices=point_6, Closed=False)
curve_4 = Curve(polyline)
