# Grasshopper definition PerturbedSystemsAndLines.gh (Grasshopper 0.9.76)

number_lanes_per_system = Slider(7, range=0..100)
number_of_systems = Slider(3, range=0..10)
system_height = Slider(6, range=0..10)

margin = Slider(0.7523, range=0..1)
rectangle = Rectangle({Plane=PlaneXY(-11.5, -8.5, 0), Size=Domain2(u=0..23, v=0..17)})
negative = Negative(Value=margin)
offset = Offset(Curve=rectangle, Distance=negative, Plane=PlaneXY(0, 0, 0), Corners=1)
curve = Curve(offset)
control_points = ControlPoints(Curve=curve)  # -> Points, Weights, Knots
bounds_2d = Bounds2D(Coordinates=control_points.Points)
deconstruct_domain² = DeconstructDomain²(Domain=bounds_2d)  # -> UComponent, VComponent
deconstruct_domain = DeconstructDomain(Domain=deconstruct_domain².UComponent)  # -> Start, End
deconstruct_domain_2 = DeconstructDomain(Domain=deconstruct_domain².VComponent)  # -> Start, End
multiplication = Multiplication(A=number_of_systems, B=system_height)
subtraction = Subtraction(A=deconstruct_domain.End, B=deconstruct_domain.Start)
workspace_height = Number(subtraction)
subtraction_2 = Subtraction(A=workspace_height, B=multiplication)
subtraction_3 = Subtraction(A=number_of_systems, B="1")
division = Division(A=subtraction_2, B=subtraction_3)
series = Series(Start=0, Step=1, Count=number_of_systems)
addition = Addition(A=division, B=system_height)
division_2 = Division(A=system_height, B=number_lanes_per_system)
multiplication_2 = Multiplication(A=addition, B=series)
addition_2 = Addition(A=deconstruct_domain.Start, B=multiplication_2)
division_3 = Division(A=division_2, B="2")
lane_height = Number(division_2)
half_lane_height = Number(division_3)
lane_height_2 = Number(division_2)
construct_point = ConstructPoint(XCoordinate=addition_2, YCoordinate=deconstruct_domain_2.Start, ZCoordinate=0)
subtraction_4 = Subtraction(A=deconstruct_domain_2.End, B=deconstruct_domain_2.Start)
point = Point(construct_point)
series_2 = Series(Start=half_lane_height, Step=lane_height_2, Count=number_lanes_per_system)
unit_x = UnitX(Factor=series_2)
unit_y = UnitY(Factor=subtraction_4)
move = Move(Geometry=graft(point), Motion=unit_x)  # -> Geometry, Transform
move_2 = Move(Geometry=move.Geometry, Motion=unit_y)  # -> Geometry, Transform
line = Line(StartPoint=move.Geometry, EndPoint=move_2.Geometry)
lines = Curve(graft(line))
lines_2 = Curve(lines)
lane_height_3 = Number(lane_height_2)

number_slider = Slider(91.5432, range=0..100)

number_slider_2 = Slider(40, range=0..1000)
seed = Slider(40, range=0..1000)
curve_2 = Curve(lines_2)
lane_height_4 = Number(lane_height_3)
divide_curve = DivideCurve(Curve=curve_2, Count=number_slider_2, Kinks=False)  # -> Points, Tangents, Parameters
horizontal_frame = HorizontalFrame(Curve=reparameterize(curve_2), Parameter="0.5")
panel = Panel("""0.25
-0.25""")
deconstruct_plane = DeconstructPlane(Plane=horizontal_frame)  # -> Origin, XAxis, YAxis, ZAxis
multiplication_3 = Multiplication(A=lane_height_4, B=panel)
dispatch = Dispatch(List=multiplication_3, DispatchPattern=[True, False])  # -> ListA, ListB
construct_domain = ConstructDomain(DomainStart=dispatch.ListA, DomainEnd=dispatch.ListB)
point_2 = Point(divide_curve.Points)

list_length = ListLength(List=flatten(curve_2))
series_3 = Series(Start=0, Step=seed, Count=list_length)  # -> graft(Series)

random = Random(Range=Domain(0, 1), Number=number_slider_2, Seed=series_3)
remap_numbers = RemapNumbers(Value=random, Source=Domain(0, 1), Target=construct_domain)  # -> Mapped, Clipped
amplitude = Amplitude(Vector=deconstruct_plane.YAxis, Amplitude=remap_numbers.Mapped)
move_3 = Move(Geometry=point_2, Motion=amplitude)  # -> Geometry, Transform
point_3 = Point(move_3.Geometry)

point_4 = Point(point_3)
nurbs_curve = NurbsCurve(Vertices=point_4, Degree=Slider(3, range=0..10), Periodic=False)  # -> Curve, Length, Domain
curve_3 = Curve(nurbs_curve.Curve)

curvature_factor = Slider(0.027, range=0..0.05)
number_slider_3 = Slider(20, range=0..10000)
curve_4 = Curve(curve_3)
divide_curve_2 = DivideCurve(Curve=curve_4, Count=number_slider_3, Kinks=False)  # -> Points, Tangents, Parameters
curvature = Curvature(Curve=curve_4, Parameter=divide_curve_2.Parameters)  # -> Point, Curvature, Curvature_2
range = Range(Domain=Domain(0, 1), Steps=number_slider_3)
vector_length = VectorLength(Vector=curvature.Curvature)
mass_addition = MassAddition(Input=vector_length)  # -> Result, PartialResults
multiplication_4 = Multiplication(A=mass_addition.PartialResults, B=curvature_factor)
construct_point_2 = ConstructPoint(XCoordinate=range, YCoordinate=multiplication_4, ZCoordinate=0)
point_5 = Point(construct_point_2)
nurbs_curve_2 = NurbsCurve(Vertices=point_5, Degree=3, Periodic=False)  # -> Curve, Length, Domain
divide_curve_3 = DivideCurve(Curve=nurbs_curve_2.Curve, Count=number_slider_3, Kinks=False)  # -> Points, Tangents, Parameters
deconstruct = Deconstruct(Point=divide_curve_3.Points)  # -> XComponent, YComponent, ZComponent
evaluate_length = EvaluateLength(Curve=curve_4, Length=deconstruct.XComponent, Normalized=True)  # -> Point, Tangent, Parameter
point_6 = Point(evaluate_length.Point)

point_7 = Point(point_6)
polyline = PolyLine(Vertices=point_7, Closed=False)
curve_5 = Curve(polyline)
