# Grasshopper definition SystemsAndLines.gh (Grasshopper 0.9.76)
# plug-ins: Python Interpreter

number_lanes_per_system = Slider(7, range=0..100)
number_of_systems = Slider(3, range=0..10)
system_height = Slider(6, range=0..10)

margin = Slider(0.7523, range=0..1)
rec = Rectangle({Plane=PlaneXY(-11.5, -8.5, 0), Size=Domain2(u=0..23, v=0..17)})
neg = Negative(Value=margin)
offset = Offset(Curve=rec, Distance=neg, Plane=PlaneXY(0, 0, 0), Corners=1)
crv = Curve(offset)
cp = ControlPoints(Curve=crv)  # -> Points, Weights, Knots
bnd = Bounds2D(Coordinates=cp.Points)
dedom2 = DeconstructDomain²(Domain=bnd)  # -> UComponent, VComponent
dedomain = DeconstructDomain(Domain=dedom2.UComponent)  # -> Start, End
dedomain_2 = DeconstructDomain(Domain=dedom2.VComponent)  # -> Start, End
multiplication = Multiplication(A=number_of_systems, B=system_height)
subtraction = Subtraction(A=dedomain.End, B=dedomain.Start)
workspace_height = Number(subtraction)
subtraction_2 = Subtraction(A=workspace_height, B=multiplication)
subtraction_3 = Subtraction(A=number_of_systems, B="1")
division = Division(A=subtraction_2, B=subtraction_3)
series = Series(Start=0, Step=1, Count=number_of_systems)
addition = Addition(A=division, B=system_height)
division_2 = Division(A=system_height, B=number_lanes_per_system)
multiplication_2 = Multiplication(A=addition, B=series)
addition_2 = Addition(A=dedomain.Start, B=multiplication_2)
division_3 = Division(A=division_2, B="2")
lane_height = Number(division_2)
half_lane_height = Number(division_3)
lane_height_2 = Number(division_2)
pt = ConstructPoint(XCoordinate=addition_2, YCoordinate=dedomain_2.Start, ZCoordinate=0)
subtraction_4 = Subtraction(A=dedomain_2.End, B=dedomain_2.Start)
pt_2 = Point(pt)
series_2 = Series(Start=half_lane_height, Step=lane_height_2, Count=number_lanes_per_system)
X = UnitX(Factor=series_2)
Y = UnitY(Factor=subtraction_4)
move = Move(Geometry=graft(pt_2), Motion=X)  # -> Geometry, Transform
move_2 = Move(Geometry=move.Geometry, Motion=Y)  # -> Geometry, Transform
ln = Line(StartPoint=move.Geometry, EndPoint=move_2.Geometry)
lines = Curve(graft(ln))
lines_2 = Curve(lines)
lane_height_3 = Number(lane_height_2)

number_slider = Slider(91.5432, range=0..100)
number_of_lanes = Integer(number_lanes_per_system)
series_3 = Series(Start="1", Step=1, Count=Slider(3, range=0..10))
series_4 = Series(Start=Slider(423, range=0..1000), Step=1, Count=number_of_lanes)  # -> graft(Series)
python = PythonScript(increment=Slider(0.05, range=0..0.1), hop_sizes=series_3, seed=series_4)  # -> out, values; inputs hop_sizes: list of Int32, seed: Int32
# ---------- python: Python ----------
import random

random.seed(seed)

def hop(start=0.0):
    delta = increment * random.choice(hop_sizes)
    return start + delta

current_value = hop()
values = [current_value]

while current_value < 1.0:
    current_value = hop(current_value)
    values.append(current_value)
# ---------- end python ----------
num = Number(python.values)
series_5 = Series(Start=0, Step=1, Count="7")
random = Random(Range=Domain(0, 1), Number="7", Seed=2)
panel = Panel(random)

number_slider_2 = Slider(40, range=0..1000)
seed = Slider(40, range=0..1000)
crv_2 = Curve(lines_2)
lane_height_4 = Number(lane_height_3)
divide = DivideCurve(Curve=crv_2, Count=number_slider_2, Kinks=False)  # -> Points, Tangents, Parameters
panel_2 = Panel("""0.25
-0.25""")
hframe = HorizontalFrame(Curve=reparameterize(crv_2), Parameter="0.5")
multiplication_3 = Multiplication(A=lane_height_4, B=panel_2)
deplane = DeconstructPlane(Plane=hframe)  # -> Origin, XAxis, YAxis, ZAxis
dispatch = Dispatch(List=multiplication_3, DispatchPattern=[True, False])  # -> ListA, ListB
dom = ConstructDomain(DomainStart=dispatch.ListA, DomainEnd=dispatch.ListB)
pt_3 = Point(divide.Points)

lng = ListLength(List=flatten(crv_2))
series_6 = Series(Start=0, Step=seed, Count=lng)  # -> graft(Series)

random_2 = Random(Range=Domain(0, 1), Number=number_slider_2, Seed=series_6)
remap = RemapNumbers(Value=random_2, Source=Domain(0, 1), Target=dom)  # -> Mapped, Clipped
amp = Amplitude(Vector=deplane.YAxis, Amplitude=remap.Mapped)
move_3 = Move(Geometry=pt_3, Motion=amp)  # -> Geometry, Transform
pt_4 = Point(move_3.Geometry)

pt_5 = Point(pt_4)
nurbs = NurbsCurve(Vertices=pt_5, Degree=Slider(3, range=0..10), Periodic=False)  # -> Curve, Length, Domain
crv_3 = Curve(nurbs.Curve)

curvature_factor = Slider(0.027, range=0..0.05)
number_slider_3 = Slider(20, range=0..10000)
crv_4 = Curve(crv_3)
divide_2 = DivideCurve(Curve=crv_4, Count=number_slider_3, Kinks=False)  # -> Points, Tangents, Parameters
curvature = Curvature(Curve=crv_4, Parameter=divide_2.Parameters)  # -> P, K, C
range = Range(Domain=Domain(0, 1), Steps=number_slider_3)
vlen = VectorLength(Vector=curvature.K)
ma = MassAddition(Input=vlen)  # -> Result, PartialResults
multiplication_4 = Multiplication(A=ma.PartialResults, B=curvature_factor)
pt_6 = ConstructPoint(XCoordinate=range, YCoordinate=multiplication_4, ZCoordinate=0)
pt_7 = Point(pt_6)
nurbs_2 = NurbsCurve(Vertices=pt_7, Degree=3, Periodic=False)  # -> Curve, Length, Domain
divide_3 = DivideCurve(Curve=nurbs_2.Curve, Count=number_slider_3, Kinks=False)  # -> Points, Tangents, Parameters
pdecon = Deconstruct(Point=divide_3.Points)  # -> XComponent, YComponent, ZComponent
eval = EvaluateLength(Curve=crv_4, Length=pdecon.XComponent, Normalized=True)  # -> Point, Tangent, Parameter
pt_8 = Point(eval.Point)

pt_9 = Point(pt_8)
pline = PolyLine(Vertices=pt_9, Closed=False)
trim = TrimTree(Tree=pline, Depth="4")
crv_5 = Curve(trim)

lines_divided_by_system = Curve(crv_5)
lane_number = Integer(graft(series_5))
position_0_1_along_continuous_multi_syst = Number(graft(random))  # "position (0-1) along continuous multi-system lane"
viewer = ParamViewer(lines_divided_by_system)
lng_2 = ListLength(List=viewer)
number_of_systems_2 = Integer(lng_2)
division_4 = Division(A="1.0", B=number_of_systems_2)
length_of_a_system = Number(division_4)
division_5 = Division(A=position_0_1_along_continuous_multi_syst, B=length_of_a_system)
round = Round(Number=division_5)  # -> Nearest, Floor, Ceiling
branch_to_pull_curve_from = Integer(round.Floor)
subtraction_5 = Subtraction(A=division_5, B=round.Floor)
item = ListItem(List=viewer, Index=branch_to_pull_curve_from, Wrap=False)
branch = TreeBranch(Tree=lines_divided_by_system, Path=item, MaintainPaths=False)
item_2 = ListItem(List=branch, Index=lane_number, Wrap=True)
eval_2 = EvaluateCurve(Curve=reparameterize(item_2), Parameter=subtraction_5)  # -> Point, Tangent, Angle
point_along_continuous_line = Point(eval_2.Point)

crv_6 = Curve(crv_5)
shift = ShiftList(List=crv_6, Shift="-1", Wrap="False")
shift_2 = ShiftList(List=crv_6, Shift="1", Wrap="False")
crv_7 = Curve(shift)
crv_8 = Curve(shift_2)
