# Grasshopper definition TwoFunctionLinePlots.gh (Grasshopper 0.9.76)

height = Slider(20.141, range=0..100)
width = Slider(15.051, range=0..100)
bounding_rect = Rectangle({Plane=PlaneXY(0.5, 0.5, 0), Size=Domain2(u=0..17, v=0..23)})

division = Division(A=height, B=2)
multiplication = Multiplication(A=division, B=-1)
dom = ConstructDomain(DomainStart=multiplication, DomainEnd=division)

division_2 = Division(A=width, B=2)
multiplication_2 = Multiplication(A=division_2, B=-1)
dom_2 = ConstructDomain(DomainStart=multiplication_2, DomainEnd=division_2)

pcen = PolygonCenter(Polyline=bounding_rect)  # -> CenterV, CenterE, CenterA
rectangle = Rectangle(Plane=pcen.CenterV, XSize=dom_2, YSize=dom, Radius=0)  # -> Rectangle, Length
bounding_frame = Curve(reparameterize(rectangle.Rectangle))
domain = Domain(dom)
explode = Explode(Curve=bounding_frame, Recursive=True)  # -> Segments, Vertices
dedomain = DeconstructDomain(Domain=domain)  # -> Start, End
item = ListItem(List=explode.Segments, Index=Slider(4, range=0..10), Wrap=True)
range = Range(Domain=domain, Steps=Slider(150, range=0..1000))
remap = RemapNumbers(Value=range, Source=domain, Target=Domain(0, 1))  # -> Mapped, Clipped
graph = GraphMapper(
    remap.Mapped,
    x0=0,
    x1=1,
    y0=0,
    y1=1,
    container_name="Bezier",
    cpx=[0, 0.05895730853, 0.9308409691, 1],
    cpy=[0, 0.6032462716, 0.3027241826, 1])
crv = Curve(item)
remap_2 = RemapNumbers(Value=graph, Source=Domain(0, 1), Target=domain)  # -> Mapped, Clipped
subtraction = Subtraction(A=remap_2.Mapped, B=dedomain.Start)
Y = UnitY(Factor=subtraction)
num = Number(subtraction)
move = Move(Geometry=crv, Motion=Y)  # -> Geometry, Transform
shift = ShiftList(List=num, Shift=1, Wrap=False)
shift_2 = ShiftList(List=num, Shift=-1, Wrap=False)
lng = ListLength(List=move.Geometry)
subtraction_2 = Subtraction(A=shift, B=shift_2)
range_2 = Range(Domain=Domain(0, 1), Steps=lng)
crv_2 = Curve(reparameterize(move.Geometry))
multiplication_3 = Multiplication(A=Slider(0.498, range=0..1), B=subtraction_2)
graph_2 = GraphMapper(
    range_2,
    x0=0,
    x1=1,
    y0=0,
    y1=1,
    container_name="Bezier",
    cpx=[0, 0.2589818835, 0.4774346948, 1],
    cpy=[0.9871010184, 0.01324862242, 0, 0.8064181805])
neg = Negative(Value=multiplication_3)
dom_3 = ConstructDomain(DomainStart=0, DomainEnd=Slider(0.303, range=0..1))
remap_3 = RemapNumbers(Value=graph_2, Source=Domain(0, 1), Target=dom_3)  # -> Mapped, Clipped
Y_2 = UnitY(Factor=neg)
neg_2 = Negative(Value=remap_3.Mapped)
addition = Addition(A="0.5", B=neg_2)
addition_2 = Addition(A="0.5", B=remap_3.Mapped)
dom_4 = ConstructDomain(DomainStart=addition, DomainEnd=addition_2)
subcrv = SubCurve(BaseCurve=crv_2, Domain=dom_4)
panel = Panel(dom_4)
crv_3 = Curve(subcrv)
move_2 = Move(Geometry=crv_3, Motion=Y_2)  # -> Geometry, Transform
