# Grasshopper definition import.gh (Grasshopper 0.9.76)
# plug-ins: Python Interpreter

path = FilePath("C:\Users\benja\projects\penplotter\rectangles\rectangles-plot-5.pkl")
python = PythonScript(pickle_file=path)  # -> out, crvs
# ---------- python: Python ----------
# Inputs
#   pickle_file, a filepath string to import
# Outputs
#   crvs, a set of polyline curves
import Rhino
import cPickle as pickle



def plottable_to_rhino(geom):
    """Takes rhino polylines or point arrays
    and outputs plottable geometries resempling linestrings
    """
    return Rhino.Geometry.PolylineCurve([
        Rhino.Geometry.Point3d(pt[0], pt[1], 0.0)
        for pt in geom
    ])

with open(pickle_file, 'rb') as pickle_file:
    crvs = [
        plottable_to_rhino(geom)
        for geom in pickle.load(pickle_file)]
# ---------- end python ----------
crv = Curve(python.crvs)
